# Grasshopper definition 0208.gh (Grasshopper 1.0.7)
# plug-ins: VolumeGeneratorBasedOnGraph

panel = Panel("""W
S
E
N""")
point = Point([Point(0, 25, 0), Point(-24, -1, 0), Point(15, -9, 0)])
point_2 = Point([Point(-58.07877569, -0.1938198873, 0), Point(1.315160513, -41.54792591, 0), Point(52.69083492, -0.1938198873, 0), Point(-1.182268104, 47.28917775, 0)])
file_path = FilePath("D:\毕业论文\VolumeGeneratorBasedOnGraph\VolumeGeneratorBasedOnGraph\测试文件夹\1221Test.csv")
constructgraph = ConstructGraph(CSVFilePath=file_path, VolumeNodePoints=point, BoundaryNodePoints=point_2, BoundaryNodeLabels=panel)
tutteconvexdrawing = TutteConvexDrawing(Graph=constructgraph)  # -> Graph, ConvexFaceBorders, SubGraph, GraphEdge
# 缺口形
curve = Curve(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)
# 正交矩形
# 四边形
curve_2 = Curve(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)
explode = Explode(Curve=curve_2, Recursive=True)  # -> Segments, Vertices
list_item = ListItem(List=explode.Segments, Index=" 0", Wrap=True)
list_item_2 = ListItem(List=explode.Segments, Index="3", Wrap=True)
list_item_3 = ListItem(List=explode.Segments, Index="2", Wrap=True)
list_item_4 = ListItem(List=explode.Segments, Index="1", Wrap=True)
line = Line(list_item)
line_2 = Line(list_item_2)
line_3 = Line(list_item_3)
line_4 = Line(list_item_4)
constructboundarysegment = ConstructBoundarySegment(SelectedBoundaryPolylineSegment=line_2, SegmentLabel="N")
constructboundarysegment_2 = ConstructBoundarySegment(SelectedBoundaryPolylineSegment=line_3, SegmentLabel="E")
constructboundarysegment_3 = ConstructBoundarySegment(SelectedBoundaryPolylineSegment=line_4, SegmentLabel="S")
constructboundarysegment_4 = ConstructBoundarySegment(SelectedBoundaryPolylineSegment=line, SegmentLabel="W")
merge = Merge(
    Data1=constructboundarysegment_4,
    Data2=constructboundarysegment_3,
    Data3=constructboundarysegment_2,
    Data4=constructboundarysegment)
triangulate = Triangulate(
    Graph=tutteconvexdrawing.Graph,
    ConvexFaceBorders=tutteconvexdrawing.ConvexFaceBorders,
    IndexOfTriangularMesh=Slider(0, range=0..12),
    ExcludeDegenerateTINS=Toggle(True))
dualusinghalfedge2 = DualUsingHalfedge2(GraphWithHM=triangulate)
reorganizeboundary3 = ReorganizeBoundary3(DualGraphWithHM=dualusinghalfedge2, BoundarySegments=merge)  # -> SortedBoundarySegments, VerticesIndexForEachBS, IndexOnEachBS, VolumeJunctionsTexts, NeedToConnectVolumeJunctionsIndex, NeedToConnectBSIndex, NeedToConnectPairCorrespondingFaceIndex, BoundaryTCounts, InnerTMaxCounts, TotalLayerCount
gene_pool = GenePool(Decimals=2, Maximum=1, Minimum=0, Value=1)
gene_pool_2 = GenePool(Decimals=2, Maximum=1, Minimum=0, Value=[0.33, 0.46, 0.43])
entwine = Entwine(Branch00=gene_pool_2, FlattenInputs=True)
entwine_2 = Entwine(Branch00=gene_pool, FlattenInputs=True)
ghcsitedivision3 = GhcSiteDivision3(
    DualGraphWithHM=dualusinghalfedge2,
    SortedBoundarySegments=reorganizeboundary3.SortedBoundarySegments,
    VerticesIndexForEachBS=reorganizeboundary3.VerticesIndexForEachBS,
    IndexOnEachBS=reorganizeboundary3.IndexOnEachBS,
    VolumeJunctionsTexts=reorganizeboundary3.VolumeJunctionsTexts,
    NeedToConnectVolumeJunctionsIndex=reorganizeboundary3.NeedToConnectVolumeJunctionsIndex,
    NeedToConnectBSIndex=reorganizeboundary3.NeedToConnectBSIndex,
    NeedToConnectPairCorrespondingFaceIndex=reorganizeboundary3.NeedToConnectPairCorrespondingFaceIndex,
    BoundaryTCounts=reorganizeboundary3.BoundaryTCounts,
    InnerTMaxCounts=reorganizeboundary3.InnerTMaxCounts,
    TotalLayerCount=reorganizeboundary3.TotalLayerCount,
    BoundaryTDT=entwine,
    InnerTMaxDT=entwine_2)  # -> TXDT, TYDT, DualGraphWithHM, DualPlanktonMesh
curve_3 = Curve(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)
curve_4 = Curve(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)
curve_5 = Curve(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)
unit_z = UnitZ(Factor=1)
boundary_surfaces = BoundarySurfaces(Edges=curve_4)  # -> reparameterize(Surfaces)
brep_wireframe = BrepWireframe(Brep=curve_4, Density=-1)
extrude = Extrude(Base=curve_2, Direction=unit_z)
list_item_5 = ListItem(List=brep_wireframe, Index=Slider(2, range=0..10), Wrap=True)
list_item_6 = ListItem(List=brep_wireframe, Index=Slider(3, range=0..10), Wrap=True)
list_item_7 = ListItem(List=brep_wireframe, Index=Slider(1, range=0..10), Wrap=True)
list_item_8 = ListItem(List=brep_wireframe, Index=Slider(0, range=0..10), Wrap=True)
cap_holes = CapHoles(Brep=extrude)
flip_curve = FlipCurve(Curve=list_item_8)  # -> Curve, Flag
flip_curve_2 = FlipCurve(Curve=list_item_6)  # -> Curve, Flag
box = Box(cap_holes)
merge_2 = Merge(Data1=flip_curve.Curve, Data2=list_item_5)
construct_domain = ConstructDomain(DomainStart=0, DomainEnd=1)
gene_pool_3 = GenePool(Decimals=1, Maximum=2, Minimum=0, Value=[0, 2])
gene_pool_4 = GenePool(Decimals=0, Maximum=2, Minimum=0, Value=[1, 2])
sweep2 = Sweep2(Rail1=list_item_7, Rail2=flip_curve_2.Curve, Sections=merge_2, SameHeight=False)
entwine_3 = Entwine(Branch0X=gene_pool_4, FlattenInputs=False)
entwine_4 = Entwine(Branch0X=gene_pool_3, FlattenInputs=False)
number_slider = Slider(4.347, range=0..20)
surface = Surface(reparameterize(sweep2))
divisionmorph = DivisionMorph(
    DualPlanktonMesh=ghcsitedivision3.DualPlanktonMesh,
    Reference=box,
    Surface=surface,
    UDomain=construct_domain,
    VDomain=construct_domain,
    WDomain=construct_domain)
showgraph = ShowGraph(PlanktonMeshOrGraphWithHFMesh=divisionmorph, OffsetDistance=Slider(0.693, range=0..1), ScreenSize=1, RelativeSize=1)

# ----
# W
# S
# E
# N
# default
number_slider_2 = Slider(2, range=0..10)
merge_3 = Merge(
    Data1=Slider(2, range=0..10),
    Data2=number_slider_2,
    Data3=Slider(2, range=0..10),
    Data4=Slider(2, range=0..10),
    Data5=Slider(2, range=0..10))

volumebaseontopo = VolumeBaseOnTopo(
    DualGraphWithHM=ghcsitedivision3.DualGraphWithHM,
    NewDualPlanktonMesh=divisionmorph,
    WhichPairSetbackNeedToChange=entwine_3,
    SetbackValueNeedToChange=entwine_4,
    SetbackList=merge_3,
    W=number_slider,
    W_2=Slider(4, range=0..5),
    LMin=Slider(3, range=0..5),
    LMax=Slider(5, range=0..5),
    D=Slider(1, range=0..5),
    Seed=Slider(5, range=0..10))  # -> DualGraphWithHMWithBS, SetBackPolyline, HCurves, VCurves
curve_6 = Curve(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)
curve_7 = Curve(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)
explode_tree = ExplodeTree(Data=volumebaseontopo.HCurves)  # -> Branch0, Branch1, Branch2
explode_tree_2 = ExplodeTree(Data=volumebaseontopo.VCurves)  # -> Branch0, Branch1, Branch2
curve_8 = Curve(volumebaseontopo.SetBackPolyline)
region_difference = RegionDifference(CurvesA=curve_6, CurvesB=curve_7)
merge_4 = Merge(Data1=explode_tree.Branch1, Data2=explode_tree_2.Branch1)
explode_tree_3 = ExplodeTree()  # -> Branch0, Branch1, Branch2
unit_z_2 = UnitZ(Factor=5)
list_item_9 = ListItem(List=curve_8, Index=Slider(1, range=0..10), Wrap=True)
curve_9 = Curve()
curve_10 = Curve()
boundary_surfaces_2 = BoundarySurfaces(Edges=merge_4)
extrude_2 = Extrude(Direction=unit_z_2)
curve_11 = Curve(explode_tree_3.Branch1)
control_points = ControlPoints(Curve=list_item_9)  # -> Points, Weights, Knots
surface_split = SurfaceSplit(Surface=boundary_surfaces_2, Curves=merge_4)
brep = Brep()
list_item_10 = ListItem(List=curve_10, Index=Slider(0, range=0..10), Wrap=True)
list_item_11 = ListItem(List=curve_11, Index=Slider(2, range=0..10), Wrap=True)
cap_holes_ex = CapHolesEx(Brep=extrude_2)  # -> Brep, Caps, Solid
point_list = PointList(Points=control_points.Points, Size=3)
boundary_surfaces_3 = BoundarySurfaces(Edges=list_item_10)
brep_wireframe_2 = BrepWireframe(Brep=surface_split, Density=-1)
boundary_surfaces_4 = BoundarySurfaces(Edges=list_item_11)
brep_curve = BrepCurve(Brep=boundary_surfaces_3, Curve=list_item_11)  # -> Curves, Points
multiplication = Multiplication(A=number_slider, B=0.5)
region_intersection = RegionIntersection(CurvesA=list_item_10, CurvesB=list_item_11)
join_curves = JoinCurves(Curves=brep_wireframe_2, Preserve=False)
brep_brep = BrepBrep(BrepA=boundary_surfaces_3, BrepB=boundary_surfaces_4)  # -> Curves, Points
list_item_12 = ListItem(List=brep, Index=Slider(2, range=0..10), Wrap=True)
list_item_13 = ListItem(List=brep, Index=Slider(0, range=0..10), Wrap=True)
list_item_14 = ListItem(List=brep, Index=Slider(1, range=0..10), Wrap=True)
negative = Negative(Value=multiplication)
list_item_15 = ListItem(List=brep_curve.Curves, Index=Slider(1, range=0..10), Wrap=True)
control_polygon = ControlPolygon(Curve=list_item_11)  # -> Polygon, Points
point_list_2 = PointList(Points=control_polygon.Points, Size=3)
curve_curve = CurveCurve(CurveA=list_item_10, CurveB=list_item_11)  # -> Points, ParamsA, ParamsB
curve_12 = Curve(brep_brep.Curves)
offset_curve = OffsetCurve(Curve=join_curves, Distance=negative, Plane=PlaneXY(0, 0, 0), Corners=1)
panel_2 = Panel(brep_curve.Curves)
merge_5 = Merge(Data1=multiplication, Data2=negative)  # -> graft(Result)
