# Grasshopper definition 1024_test.gh (Grasshopper 1.0.7)
# plug-ins: VolumeGeneratorBasedOnGraph

point = Point([Point(-124.2152059, 130.3654424, 0), Point(-141.2715408, 118.6023947, 0), Point(-119.5321523, 124.2562283, 0), Point(-128.9355463, 136.9176304, 0), Point(-147.1310498, 130.5355352, 0), Point(-134.0098754, 117.4371825, 0), Point(-139.0266574, 107.8069307, 0), Point(-144.1063482, 133.0953203, 0), Point(-137.8852252, 140.0707786, 0)])
point_2 = Point([Point(-137.1369182, 155.4221792, 0), Point(-163.1032157, 136.7682298, 0), Point(-162.3570578, 106.474216, 0), Point(-129.6753384, 90.95413009, 0), Point(-108.9321467, 110.8019323, 0), Point(-105.49982, 137.3651562, 0)])
file_path = FilePath("C:\Users\52305\Desktop\测试gh文件\ProgramWithMoreBoundary.csv")
globals = Globals(VolumeNodePoints=point, BoundaryNodePoints=point_2)
csvreader = CSVReader(GlobalParameter=globals, CSVFilePath=file_path)  # -> VolumeConnectivityTree, BoundaryAdjacencyTree, VolumeNodeAttributes
panel = Panel("""N1
W
S
E1
N2
E2""")
constructgraph = ConstructGraph(
    GlobalParameter=globals,
    VolumeConnectivityTree=csvreader.VolumeConnectivityTree,
    BoundaryAdjacencyTree=csvreader.BoundaryAdjacencyTree,
    VolumeNodeAttributes=csvreader.VolumeNodeAttributes,
    BoundaryNodeLabels=panel)  # -> Graph, GraphNodePoints, GraphNodeAttributes
